# Grasshopper definition Flat Tessellations.gh (Grasshopper 1.0.7)

# ----
# Help!: It means that in 3rd layer and 7th layer, we will have 5 nodes (instead of the default amount)
special_degrees = Panel("""3,5
7,5""")

central_shape = Slider(6, range=3..10)
around_shapes = Slider(4, range=4..10)
each_degree = Slider(4, range=4..10)
levels = Slider(4, range=0..10)
make_tessellation = CSharpScript(
    CentralPolygon=central_shape,
    OtherPolygons=around_shapes,
    Degree=each_degree,
    Levels=levels,
    SpecialDegrees=special_degrees,
    Reference=["D:\Programming\25-02-06 Graph Polygon\DLLs\ILGPU.Algorithms.dll", "D:\Programming\25-02-06 Graph Polygon\DLLs\ILGPU.dll", "D:\Programming\25-02-06 Graph Polygon\DLLs\System.Buffers.dll", "D:\Programming\25-02-06 Graph Polygon\DLLs\System.Collections.Immutable.dll", "D:\Programming\25-02-06 Graph Polygon\DLLs\System.Memory.dll", "D:\Programming\25-02-06 Graph Polygon\DLLs\System.Numerics.Vectors.dll", "D:\Programming\25-02-06 Graph Polygon\DLLs\System.Reflection.Metadata.dll", "D:\Programming\25-02-06 Graph Polygon\DLLs\System.Runtime.CompilerServices.Unsafe.dll", "D:\Programming\25-02-06 Graph Polygon\DLLs\Truss v2.dll", "D:\Programming\25-02-06 Graph Polygon\DLLs\TessellationGraph.dll"])  # -> out, Points, Lines, Polygons, TessellationGraph; inputs CentralPolygon: Int32, OtherPolygons: Int32, Degree: Int32, Levels: Int32, SpecialDegrees: list of String
# ---------- make_tessellation: C# usings ----------
using Liz;
# ---------- make_tessellation: C# ----------
    List<Tuple<int,int>> special_degrees = new List<Tuple<int,int>>();
    foreach(string line in SpecialDegrees){
      string[] parts = line.Split(',');
      int index = int.Parse(parts[0].Trim());
      int amount = int.Parse(parts[1].Trim());
      special_degrees.Add(new Tuple<int, int>(index, amount));
    }
    Liz.TessellationGraph tg = new Liz.TessellationGraph(CentralPolygon, OtherPolygons, Degree, special_degrees);
    tg.UpdateGraph(Levels);

    Points = tg.PointsOf();
    Lines = tg.LinesOf();
    Polygons = tg.PolygonsOf();
    TessellationGraph = tg;
# ---------- end make_tessellation ----------

# ----
# Presentation
curve = Curve(<curve referenced from the Rhino model>)
line = Line(make_tessellation.Lines)
bounding_box = BoundingBox(Content=line, Plane=PlaneXY(0, 0, 0), UnionBox=True)  # -> Box, Box_2
bounding_box_2 = BoundingBox(Content=curve, Plane=PlaneXY(0, 0, 0), UnionBox=False)  # -> Box, Box_2
ghpython_script = GhPythonScript(x=central_shape, y=around_shapes, z=each_degree, u=levels)  # -> out, a
# ---------- ghpython_script: Python ----------
__author__ = "pedra"
__version__ = "2025.02.19"

import rhinoscriptsyntax as rs




a = ("(Inner Polygon Sides: {}, "
     "Outer Polygon Sides: {},\n "
     "Each Node Degree: {}, "
     "Number of Iterations: {})").format(x, y, z, u)
# ---------- end ghpython_script ----------
point = Point(<point referenced from the Rhino model>)
text_tag_3d = TextTag3D(Location=point, Text=ghpython_script.a, Size="2.2", Colour=ColourSwatch(SwatchColor=RGB(0, 0, 0)), Justification=5)
rectangle_mapping = RectangleMapping(Geometry=line, Source=bounding_box.Box_2, Target=bounding_box_2.Box)  # -> Geometry, Transform
custom_preview = CustomPreview(Geometry=rectangle_mapping.Geometry, Material=ColourSwatch(SwatchColor=RGB(0, 0, 0)))
