# Grasshopper definition Tent Design.gh (Grasshopper 1.0.7)

central_shape = Slider(8, range=3..10)
around_shapes = Slider(4, range=3..10)
each_degree = Slider(4, range=4..10)
levels = Slider(5, range=0..10)
# Help!: In this case, we do not need low Damper Constant and we can achieve the final form much faster, however, you can lower the Damper to see the form shaping
# Help!: We also have to put the initial length of each beam on a very low number so it simulate the Tensile nature of the edges of each component
make_tessellation = CSharpScript(
    CentralPolygon=central_shape,
    OtherPolygons=around_shapes,
    Degree=each_degree,
    Levels=levels,
    Reference=["D:\Programming\25-02-06 Graph Polygon\DLLs\ILGPU.Algorithms.dll", "D:\Programming\25-02-06 Graph Polygon\DLLs\ILGPU.dll", "D:\Programming\25-02-06 Graph Polygon\DLLs\System.Buffers.dll", "D:\Programming\25-02-06 Graph Polygon\DLLs\System.Collections.Immutable.dll", "D:\Programming\25-02-06 Graph Polygon\DLLs\System.Memory.dll", "D:\Programming\25-02-06 Graph Polygon\DLLs\System.Numerics.Vectors.dll", "D:\Programming\25-02-06 Graph Polygon\DLLs\System.Reflection.Metadata.dll", "D:\Programming\25-02-06 Graph Polygon\DLLs\System.Runtime.CompilerServices.Unsafe.dll", "D:\Programming\25-02-06 Graph Polygon\DLLs\Truss v2.dll", "D:\Programming\25-02-06 Graph Polygon\DLLs\TessellationGraph.dll"])  # -> out, Points, Lines, Polygons, TessellationGraph; inputs CentralPolygon: Int32, OtherPolygons: Int32, Degree: Int32, Levels: Int32, SpecialDegrees: list of String
# ---------- make_tessellation: C# usings ----------
using Liz;
# ---------- make_tessellation: C# ----------
    /*
    // Convert to List<Tuple<int, int>>, LINQ solution, but I think the old way is more readable
    List<Tuple<int, int>> tuples = lines
      .Select(line => line.Split(',')) // Split each string by comma
      .Select(parts => Tuple.Create(int.Parse(parts[0]), int.Parse(parts[1]))) // Convert to Tuple<int, int>
      .ToList(); // Convert to List
    */

    List<Tuple<int,int>> special_degrees = new List<Tuple<int,int>>();
    //special_degrees.Add(new Tuple<int, int>(5, 5));
    foreach(string line in SpecialDegrees){
      string[] parts = line.Split(',');
      //foreach(var part in parts){
      //Print(part);
      //}
      //Print("===");
      int index = int.Parse(parts[0].Trim());
      int amount = int.Parse(parts[1].Trim());
      //Print(amount.ToString());
      special_degrees.Add(new Tuple<int, int>(index, amount));
    }
    Liz.TessellationGraph tg = new Liz.TessellationGraph(CentralPolygon, OtherPolygons, Degree, special_degrees);
    tg.UpdateGraph(Levels);

    //Points = tg.PointsOf();
    Lines = tg.LinesOf();
    //Polygons = tg.PolygonsOf();
    TessellationGraph = tg;
# ---------- end make_tessellation ----------
device_type = ValueList({"CPU", "ThreadCPU", "ILGPU-OpenCL", "ILGPU-CUDA"}, selected="ILGPU-OpenCL")

# ----
# Help!: With these two components, you can change the surrounding boundary of the tent, as well as the height of the tallest part of the tensile structure
boundary_curve = Curve(<curve referenced from the Rhino model>)
height = Panel("53")
construct_point = ConstructPoint(XCoordinate=0, YCoordinate=0, ZCoordinate=height)

add_helping_beams = BooleanToggle(False)
add_diagonals = BooleanToggle(False)
only_polygons = BooleanToggle(False)
helperstiffnessfactor = Panel("0.5")
stiffness = Panel("10")
stiffness_df = Panel("1")
len_df = Panel("1")
len = Panel("0.1")
# Don't forget to add the Assemblies to these two components!
make_truss_from_tessellation = CSharpScript(
    DeviceType=device_type,
    inTessellationGraph=make_tessellation.TessellationGraph,
    AroundCurve=boundary_curve,
    InnerLayerHeight=height,
    DamperConstant="20",
    OnlyPolygons=only_polygons,
    AddDiagonals=add_diagonals,
    AddHelpingBeams=add_helping_beams,
    EdgeLen=len,
    EdgeStiffness=stiffness,
    LenDF=len_df,
    StiffnessDF=stiffness_df,
    HelperStiffnessFactor=helperstiffnessfactor,
    Reference=["D:\Programming\25-02-06 Graph Polygon\DLLs\ILGPU.Algorithms.dll", "D:\Programming\25-02-06 Graph Polygon\DLLs\ILGPU.dll", "D:\Programming\25-02-06 Graph Polygon\DLLs\System.Buffers.dll", "D:\Programming\25-02-06 Graph Polygon\DLLs\System.Collections.Immutable.dll", "D:\Programming\25-02-06 Graph Polygon\DLLs\System.Memory.dll", "D:\Programming\25-02-06 Graph Polygon\DLLs\System.Numerics.Vectors.dll", "D:\Programming\25-02-06 Graph Polygon\DLLs\System.Reflection.Metadata.dll", "D:\Programming\25-02-06 Graph Polygon\DLLs\System.Runtime.CompilerServices.Unsafe.dll", "D:\Programming\25-02-06 Graph Polygon\DLLs\Truss v2.dll", "D:\Programming\25-02-06 Graph Polygon\DLLs\TessellationGraph.dll"])  # -> out, outTruss, BeamCount, DiagonalsCount, outPolygonGraph; inputs DeviceType: String, AroundCurve: Curve, InnerLayerHeight: Double, DamperConstant: Double, OnlyPolygons: Boolean, AddDiagonals: Boolean, AddHelpingBeams: Boolean, EdgeLen: Double, EdgeStiffness: Double, LenDF: Double, StiffnessDF: Double, HelperStiffnessFactor: Double
# ---------- make_truss_from_tessellation: C# usings ----------
using Liz;
using System.Linq;

#region Mask Class
/// <summary>
/// The <c>Mask</c> class is used to map the nodes of the TessellationGraph.
/// When <paramref name="OnlyPolygons"/> is true, only nodes that are part of polygons are kept (filtering out leaves or non-polygon nodes).
/// Otherwise, all nodes are included.
/// </summary>
class Mask
{
  // Private fields
  private readonly int[] _masks;

  // Properties
  // Outputs of The Class, the data from the construction of the mask that we will use in the MakeTrussFromShape
  public int NumberOfNodesInTheLastLayer { get; private set; }
  public int IndexOfLastLayer { get; private set; }
  public int NumberOfActiveNodes { get; private set; }

  // Constructors
  /// <summary>
  /// Initializes a new instance of the <see cref="Mask"/> class.
  /// </summary>
  /// <param name="points">List of points from the tessellation graph.</param>
  /// <param name="polygonGraph">Graph describing the polygon faces (each face is an array of node indices).</param>
  /// <param name="layer">Array indicating the layer index for each node.</param>
  /// <param name="onlyPolygons">If true, only nodes inside polygons are mapped; otherwise, all nodes are mapped.</param>
  /// <param name="lastLayerCount">Outputs the number of nodes in the outermost layer.</param>
  /// <param name="lastLayerIndex">Outputs the index of the last (outermost) layer.</param>
  /// <param name="nodesWeHave">Outputs the total number of nodes that are included after masking.</param>
  public Mask(List<Point3d> points, int[][] polygonGraph, int[] layer, bool onlyPolygons)
  {

    if (onlyPolygons)
    {
      // Initialize all nodes as -1 (ignored)
      _masks = Enumerable.Repeat(-1, points.Count).ToArray();
      NumberOfActiveNodes = 0;
      // Only map nodes that are part of a polygon.
      foreach (var polygon in polygonGraph)
      {
        foreach (var node in polygon)
        {
          if (_masks[node] == -1)
          {
            _masks[node] = NumberOfActiveNodes;
            NumberOfActiveNodes++;
          }
        }
      }
    }
    else
    {
      // If all nodes are needed, just map them in order.
      _masks = Enumerable.Range(0, points.Count).ToArray();
      NumberOfActiveNodes = points.Count;
    }

    // Determine the highest layer index among the nodes that are used.
    IndexOfLastLayer = 0;
    for (int i = 0; i < points.Count; i++)
    {
      if (_masks[i] != -1) IndexOfLastLayer = Math.Max(IndexOfLastLayer, layer[i]);
    }

    // Count the nodes that lie in the last (outermost) layer.
    NumberOfNodesInTheLastLayer = 0;
    for (int i = 0; i < points.Count; i++)
    {
      if (_masks[i] != -1 && layer[i] == IndexOfLastLayer) NumberOfNodesInTheLastLayer++;
    }

  }

  // Public methods
  /// <summary>
  /// Gets the mapped index for the provided node index.
  /// </summary>
  /// <param name="index">Original node index.</param>
  /// <returns>
  /// The remapped index if the node is included; otherwise, -1.
  /// </returns>
  public int Get(int index)
  {
    return _masks[index];
  }
}
#endregion
# ---------- make_truss_from_tessellation: C# ----------
    // Cast the input object to a TessellationGraph.
    Liz.TessellationGraph tessellationGraph = new Liz.TessellationGraph((Liz.TessellationGraph) inTessellationGraph);
    int beamCount, diagonalCount;
    int[][] polygonGraphOutput;

    // Set global beam properties.
    _beamLen = EdgeLen;
    _beamStiffness = EdgeStiffness;
    _lenDiminishingFactor = LenDF;
    _stiffnessDiminishingFactor = StiffnessDF;

    // Generate the truss structure from the tessellation graph.
    Liz.Truss truss = MakeTrussFromShape(tessellationGraph, out beamCount, out diagonalCount, out polygonGraphOutput, DeviceType, DamperConstant, OnlyPolygons,
      AddDiagonals, AddHelpingBeams, HelperStiffnessFactor, AroundCurve, InnerLayerHeight);

    // Assign output parameters.
    outTruss = truss;
    BeamCount = beamCount;
    DiagonalsCount = diagonalCount;
    outPolygonGraph = polygonGraphOutput;
# ---------- make_truss_from_tessellation: C# additional code ----------
  #region Private Fields

  // Private variables for beam properties.
  // basic length of each beam
  private double _beamLen;
  // basic stiffness of each beam
  private double _beamStiffness;
  // diminishing factors for length and stiffness
  private double _lenDiminishingFactor;
  private double _stiffnessDiminishingFactor;

  // for adding randomness to the code when needed
  Random _random;
  // Nodes of the truss, will be used to construct the truss
  ProtoNode[] _tempNodes;
  // Beams of the truss, will be used to construct the truss
  List<Liz.ProtoBeam> _tempBeams;
  // Track beams already added (prevents duplicates in helping beams).
  HashSet<Tuple<int, int>> _drawnBeams;

  // data from the tessellation graph.
  List<Point3d> _points; // nodes of the graph
  int[][] _adjacencyGraph; // the main adjacency graph of the TessellationGraph
  int[][] _polygonsGraph; // list of polygons in TessellationGraph
  int[] _layers; // layers of each node

  // Create a mask to map original node indices to filtered indices.
  Mask _outputIndex;

  // the number of active nodes in the last layer. if the onlyPolygon is true, it migh cause
  // many of the nodes of last layer get deleted
  int _lastLayerCount;
  // in some cases, the onlyPolygon==True can completely eradicate the last layer, so we have to doube check it
  int _lastLayerIndex;
  // the amount of nodes that are active. if the onlyPolygon is false, this will be equal
  // to points.Count, but if not, it will be less
  int _nodesWeHave;

  #endregion

  #region Main Function (MakeTrussFromShape)
  /// <summary>
  /// Constructs a truss from the input tessellation graph.
  /// </summary>
  /// <param name="shape">Input tessellation graph.</param>
  /// <param name="beamCount">Outputs the count of primary beams.</param>
  /// <param name="diagonalsCount">Outputs the count of diagonal beams added.</param>
  /// <param name="newPolygonGraph">Outputs a remapped polygon graph after masking.</param>
  /// <param name="deviceType">The type of simulator the truss is going to use.</param>
  /// <param name="damperConstant">Damper constant for the simulation.</param>
  /// <param name="onlyPolygons">If true, only nodes part of a polygon are used.</param>
  /// <param name="addDiagonals">If true, diagonal beams are added to preserve polygon shapes.</param>
  /// <param name="addHelpingBeams">If true, helping beams are added to prevent folding.</param>
  /// <param name="helpersStiffnessFactor">Factor to reduce the stiffness of helping beams.</param>
  /// <param name="aroundCurve">
  /// Optional curve. When provided, nodes in the outer layer are fixed along this curve (useful for minimal surfaces or tent shapes).
  /// </param>
  /// <returns>A new <c>Truss</c> structure.</returns>
  Liz.Truss MakeTrussFromShape(Liz.TessellationGraph shape, out int beamCount, out int diagonalsCount, out int[][] newPolygonGraph,
    string deviceType, double damperConstant, bool onlyPolygons, bool addDiagonals, bool addHelpingBeams,
    double helpersStiffnessFactor, Curve aroundCurve, double innerLayerHeight)
  {
    // for adding randomness to the code when needed
    _random = new Random();
    // Beams of the truss, will be used to construct the truss
    _tempBeams = new List<Liz.ProtoBeam>();
    // Track beams already added (prevents duplicates in helping beams).
    _drawnBeams = new HashSet<Tuple<int, int>>();

    // Get data from the tessellation graph.
    _points = shape.PointsOf();
    _adjacencyGraph = shape.GraphOf();
    _polygonsGraph = shape.PolygonsGraphOf();
    _layers = shape.LayersOf();


    // Create a mask to map original node indices to filtered indices.
    _outputIndex = new Mask(_points, _polygonsGraph, _layers, onlyPolygons);
    // store the data about number of active nodes and last layer from Mask outputs
    _lastLayerCount = _outputIndex.NumberOfNodesInTheLastLayer;
    _lastLayerIndex = _outputIndex.IndexOfLastLayer;
    _nodesWeHave = _outputIndex.NumberOfActiveNodes;

    // Initialize the nodes with correct position, force and support type
    InitialNodes(aroundCurve, innerLayerHeight);
    // Initalize the main beams, according to adjacency graph
    AddMainBeams();
    beamCount = _tempBeams.Count;
    // Add diagonal beams within polygon faces to help maintain their shape.
    if (addDiagonals)
    {
      AddDiagonalBeams();
    }

    // Calculate the count of diagonal beams added.
    diagonalsCount = _tempBeams.Count - beamCount;

    // Add helping beams to prevent the structure from folding.
    if (addHelpingBeams)
    {
      AddHelperBeams(helpersStiffnessFactor);
    }

    // Build a new polygon graph mapping with remapped node indices.
    MakeNewPolygonGraph(out newPolygonGraph);

    // Create the truss using the generated nodes and beams.
    Liz.Truss output = new Liz.Truss(_tempNodes.ToList(), _tempBeams, deviceType);
    output.DamperConstant = damperConstant;

    return output;
  }
  #endregion

  #region Elements of MakeTrussFromShape
  /// <summary>
  /// Initializes the nodes for the truss by assigning positions, forces, and support conditions
  /// based on the tessellation graph data and an optional aroundCurve for outer-layer node positioning.
  /// </summary>
  /// <param name="aroundCurve">
  /// Optional. When provided, divides the curve into segments and fixes the outer-layer nodes to these positions.
  /// </param>
  void InitialNodes(Curve aroundCurve, double innerLayerHeight)
  {
    _tempNodes = new ProtoNode[_nodesWeHave];
    // list of the fixed points on curve, output of the Divide by curve, if we receive an aroundCurve
    Point3d[] PointsOnAroundCurve = Array.Empty<Point3d>();

    // If an AroundCurve is provided, divide it into segments based on the number of outer layer nodes.
    if (aroundCurve != null)
    {
      aroundCurve.DivideByCount(_lastLayerCount, true, out PointsOnAroundCurve);
    }
    // This will be used when we have aroundCurve, to help track putting the nodes on the curve.
    int lastLayerNodesPointer = 0;
    // Initialize nodes with positions, forces, and support conditions.
    for (int i = 0; i < _points.Count; i++)
    {
      // check if the node is active
      if (_outputIndex.Get(i) != -1)
      {
        // These are the default variables for position, force and support type of the node.
        Point3d position;
        Vector3d force;
        int supportType;

        // -------------------------------------------------------------- Special Code
        // Here, we can edit those variables according to our goal
        // Start with a random offset to push the node into 3D (original graph is 2D).
        position = _points[i] + new Point3d(0, 0, _random.NextDouble() * 2 - 1);
        // no force for this implementation
        force = new Vector3d(0, 0, 0);
        // all the nodes are free (0)
        supportType = 0;
        if (_layers[i] == 0)
        {
          position = _points[i] + new Point3d(0, 0, innerLayerHeight);
          supportType = 1;
          // Here, we set the received force vector to inner layer, to simulate the tent structure.
          //force = innerLayerForceVector;
        }
        // -------------------------------------------------------------- Special Code


        // If an AroundCurve is provided and the node is in the outermost layer, place it on the curve and fix it.
        if (aroundCurve != null && _layers[i] == _lastLayerIndex)
        {
          position = PointsOnAroundCurve[lastLayerNodesPointer];
          lastLayerNodesPointer++;
          supportType = 7;
        }
        // Create and store the proto node.
        Liz.ProtoNode tmp = new Liz.ProtoNode(position);
        tmp.Force = force;
        tmp.SupportType = supportType;
        _tempNodes[_outputIndex.Get(i)] = tmp;
      }
    }
  }

  /// <summary>
  /// Adds the main beams to the truss based on the adjacency graph of the tessellation.
  /// A beam is added between nodes only if the neighbor's remapped index is greater than the current node's index,
  /// ensuring that duplicate beams are not created.
  /// </summary>
  void AddMainBeams(){
    // Create main beams based on graph connectivity.
    for (int i = 0; i < _points.Count; i++)
    {
      if (_outputIndex.Get(i) != -1)
      {
        int v_i = _outputIndex.Get(i);
        int v_iLayer = _layers[i];
        foreach (int neighbor in _adjacencyGraph[i])
        {
          if (_outputIndex.Get(neighbor) != -1 && (_outputIndex.Get(neighbor) > v_i))
          {
            int v_j = _outputIndex.Get(neighbor);
            int v_jLayer = _layers[neighbor];
            // Add a beam with properties adjusted by layer information.
            _tempBeams.Add(new Liz.ProtoBeam(v_i, v_j, LenByLayers(v_iLayer, v_jLayer), StiffnessByLayers(v_iLayer, v_jLayer)));
            _drawnBeams.Add(OrderedPair(v_i, v_j)); // Track to avoid duplicate beams.
          }
        }
      }
    }

  }

  /// <summary>
  /// Adds diagonal beams within each polygon face to help preserve the shape of the polygon.
  /// The beam lengths are computed using geometric formulas based on the polygon's circumradius,
  /// and then adjusted with the diminishing factors.
  /// </summary>
  void AddDiagonalBeams(){
    foreach (int[] polygon in _polygonsGraph)
    {
      int polygonSize = polygon.Length;
      // Calculate the polygon's circumradius based on the beam length.
      double radius = _beamLen / (2.0 * Math.Sin(Math.PI / (double) polygonSize));
      for (int i = 0; i < polygonSize - 1; i++)
      {
        int v_i = _outputIndex.Get(polygon[i]);
        for (int j = i + 2; j < polygonSize; j++)
        {
          int v_j = _outputIndex.Get(polygon[j]);
          if (j == polygonSize - 1 && i == 0) continue; // Skip the edge case.
          double archFraction = (double) (j - i) / polygonSize;
          double len = 2 * radius * Math.Sin(Math.PI * archFraction);

          _tempBeams.Add(new Liz.ProtoBeam(v_i, v_j,
            LenByLayers(_layers[polygon[i]], _layers[polygon[j]], len),
            StiffnessByLayers(_layers[polygon[i]], _layers[polygon[j]])));

          _drawnBeams.Add(OrderedPair(v_i, v_j)); // Prevent duplicate diagonal beams.
        }
      }
    }
  }

  /// <summary>
  /// Adds helper beams between nodes that share a common neighbor (excluding those in the outermost layer)
  /// to prevent the structure from folding onto itself. The beam length is set to twice the base beam length,
  /// and its stiffness is reduced by the provided helper stiffness factor.
  /// </summary>
  /// <param name="helpersStiffnessFactor">
  /// The factor by which the stiffness of the helper beams is reduced compared to the primary beams.
  /// </param>
  void AddHelperBeams(double helpersStiffnessFactor)
  {
    for (int p = 0; p < _points.Count; p++)
    {
      if (_outputIndex.Get(p) != -1)
      {
        for (int i = 0; i < _adjacencyGraph[p].Length; i++)
        {
          int v_i = _outputIndex.Get(_adjacencyGraph[p][i]);
          // Only add helping beams for nodes that are not in the last (outer) layer.
          if (v_i != -1 && _layers[_adjacencyGraph[p][i]] != _lastLayerIndex)
          {
            for (int j = i + 1; j < _adjacencyGraph[p].Length; j++)
            {
              int v_j = _outputIndex.Get(_adjacencyGraph[p][j]);
              if (v_j != -1 && _layers[_adjacencyGraph[p][j]] != _lastLayerIndex && !_drawnBeams.Contains(OrderedPair(v_i, v_j)))
              {
                // The length is set to twice the beam length (sum of the two connections),
                // and the stiffness is reduced by the helper factor.
                int v_iLayer = _layers[_adjacencyGraph[p][i]];
                int v_jLayer = _layers[_adjacencyGraph[p][j]];
                _tempBeams.Add(new Liz.ProtoBeam(v_i, v_j,
                  LenByLayers(v_iLayer, v_jLayer, 2 * _beamLen),
                  StiffnessByLayers(v_iLayer, v_jLayer, _beamStiffness * helpersStiffnessFactor)));
                _drawnBeams.Add(OrderedPair(v_i, v_j));
              }
            }
          }
        }
      }
    }
  }

  /// <summary>
  /// Constructs a new polygon graph by remapping the original polygon lists using the node index mask.
  /// This new graph reflects the active node indices after filtering.
  /// </summary>
  /// <param name="newPolygonGraph">
  /// Outputs the new polygon graph, where each polygon's node indices correspond to the remapped active nodes.
  /// </param>
  void MakeNewPolygonGraph(out int[][] newPolygonGraph)
  {
    newPolygonGraph = new int[_polygonsGraph.Length][];
    for (int i = 0; i < _polygonsGraph.Length; i++)
    {
      newPolygonGraph[i] = new int[_polygonsGraph[i].Length];
      for (int j = 0; j < _polygonsGraph[i].Length; j++)
      {
        newPolygonGraph[i][j] = _outputIndex.Get(_polygonsGraph[i][j]);
      }
    }
  }
  #endregion

  #region Private Helper Functions

  /// <summary>
  /// Calculates the stiffness of a beam based on the average layer of its two nodes.
  /// </summary>
  /// <param name="layer1">Layer of the first node.</param>
  /// <param name="layer2">Layer of the second node.</param>
  /// <param name="beamStiffness">
  /// Optional custom stiffness. If not provided, the global <c>_beamStiffness</c> is used.
  /// </param>
  /// <returns>Computed stiffness value.</returns>
  double StiffnessByLayers(int layer1, int layer2, double? beamStiffness = null)
  {
    return (beamStiffness ?? _beamStiffness) * Math.Pow(_stiffnessDiminishingFactor, (double) (layer1 + layer2) / 2.0);
  }

  /// <summary>
  /// Calculates the length of a beam based on the average layer of its two nodes.
  /// </summary>
  /// <param name="layer1">Layer of the first node.</param>
  /// <param name="layer2">Layer of the second node.</param>
  /// <param name="beamLen">
  /// Optional custom length. If not provided, the global <c>_beamLen</c> is used.
  /// </param>
  /// <returns>Computed beam length.</returns>
  double LenByLayers(int layer1, int layer2, double? beamLen = null)
  {
    return (beamLen ?? _beamLen) * Math.Pow(_lenDiminishingFactor, (double) (layer1 + layer2) / 2.0);
  }

  /// <summary>
  /// Returns an ordered pair of integers (smallest first), used to keep track of unique beam connections.
  /// </summary>
  /// <param name="a">First integer value.</param>
  /// <param name="b">Second integer value.</param>
  /// <returns>A tuple with the smaller value first.</returns>
  static Tuple<int, int> OrderedPair(int a, int b)
  {
    return Tuple.Create(Math.Min(a, b), Math.Max(a, b));
  }
  #endregion
# ---------- end make_truss_from_tessellation ----------
diagonals = BooleanToggle(False)
# Warning!: Higher update count means more computation in each step, so it make the convergence faster. However, be careful to set it properly because high update count can make Grasshopper unresponsive. The proper number of updates relates on the size of Truss, the Device that you are using (GPU-CUDA, GPU-OpenCL or CPU) and your system specifications.
helpers = BooleanToggle(False)
pause = Button()
reset = Button()
# Help!: Push the reset bottom after each change in the Truss to restart the run
run = BooleanToggle(False)
step = Button()
# Help!: If the run is false, you still can run one step of the simulation with pushing the Step botton
run_2 = CSharpScript(
    RUN=run,
    RESET=reset,
    STEP=step,
    PAUSE=pause,
    PolygonGraph=make_truss_from_tessellation.outPolygonGraph,
    ShowDiagonals=diagonals,
    ShowHelpers=helpers,
    inTruss=make_truss_from_tessellation.outTruss,
    BeamCount=make_truss_from_tessellation.BeamCount,
    DiagonalsCount=make_truss_from_tessellation.DiagonalsCount,
    UpdateCount="1000",
    Reference=["D:\Programming\24-04-05 Truss Simulation\DLLs\ILGPU.Algorithms.dll", "D:\Programming\24-04-05 Truss Simulation\DLLs\ILGPU.dll", "D:\Programming\24-04-05 Truss Simulation\DLLs\System.Buffers.dll", "D:\Programming\24-04-05 Truss Simulation\DLLs\System.Collections.Immutable.dll", "D:\Programming\24-04-05 Truss Simulation\DLLs\System.Memory.dll", "D:\Programming\24-04-05 Truss Simulation\DLLs\System.Numerics.Vectors.dll", "D:\Programming\24-04-05 Truss Simulation\DLLs\System.Reflection.Metadata.dll", "D:\Programming\24-04-05 Truss Simulation\DLLs\System.Runtime.CompilerServices.Unsafe.dll", "D:\Programming\24-04-05 Truss Simulation\DLLs\Truss v2.dll", "D:\Programming\25-02-06 Graph Polygon\DLLs\TessellationGraph.dll"])  # -> out, port, Nodes, ReactionForces, Beams, Diagonals, Helpers, Polygons, BeamsForces, FreeForce; inputs RUN: Boolean, RESET: Boolean, STEP: Boolean, PAUSE: Boolean, PolygonGraph: list, ShowDiagonals: Boolean, ShowHelpers: Boolean, BeamCount: Int32, DiagonalsCount: Int32, UpdateCount: Int32
# ---------- run_2: C# usings ----------
using Liz;
using System.Linq;
# ---------- run_2: C# ----------
    __ = "Do the simulation, step by step";


    Func<int, int> Main = _ => {
      // Check if it is in reset?
      if(RESET){
        IsRunning = false;
        Reset();
        NeedToInit = true;
        return 1;
      }

      // Change in Run status
      if(IsRunning != RUN){
        if(RUN == true){
          IsRunning = true;
        }else{
          Stop();
          IsRunning = false;
          return 1;
        }
      }

      // Run Part of the code
      if((IsRunning && !PAUSE) || STEP){
        if(NeedToInit) {
          Initialize(inTruss, BeamCount, DiagonalsCount, PolygonGraph);
          NeedToInit = false;
        }
        Run(UpdateCount, ShowDiagonals, ShowHelpers);
      }
      return 1;
      };
    Main(1);


    Nodes = m_nodes;
    ReactionForces = m_rforces;
    Beams = m_beams;
    if(ShowDiagonals){
      Diagonals = m_diagonals;
    }
    if(ShowHelpers){
      Helpers = m_helpers;
    }
    BeamsForces = m_bforces;
    FreeForce = internal_free_force;
    Polygons = m_polygons;
# ---------- run_2: C# additional code ----------
  // Control Flow
  bool IsRunning = false;
  bool NeedToInit = true;


  // fields of the class
  Liz.Truss cTruss;
  //Liz.TessellationGraph cGraph;
  // output fields:
  Point3d[] m_nodes;
  Vector3d[] m_rforces;
  Line[] m_beams, m_helpers, m_diagonals;
  double[] m_bforces;
  double internal_free_force;
  int m_beamCount, m_diagonalsEndPointer;
  Rhino.Geometry.Polyline[] m_polygons;
  int [][] m_polygon_graph;
  // methods

  public override void AfterRunScript()
  {
    if(IsRunning)
      this.Component.ExpireSolution(true);
  }

  private void Initialize(object in_truss, int BeamCount, int DiagonalsCount, List<object> PolygonGraph){
    cTruss = new Liz.Truss((Liz.Truss) (in_truss));
    //cGraph = new Liz.TessellationGraph((Liz.TessellationGraph) TessellationGraph);
    m_beamCount = BeamCount;
    m_diagonalsEndPointer = BeamCount + DiagonalsCount;
    cTruss.Compile();
    m_nodes = new Point3d[0];
    m_rforces = new Vector3d[0];//[cTruss.ProtoNodes.Count];
    m_beams = new Line[BeamCount];
    m_diagonals = new Line[DiagonalsCount];
    m_helpers = new Line[cTruss.ProtoBeams.Count - m_diagonalsEndPointer];
    m_bforces = new double[cTruss.ProtoBeams.Count];
    //m_graph = cGraph.PolygonsGraphOf();
    m_polygon_graph = PolygonGraph.Cast<int[]>().ToArray();
    m_polygons = new Rhino.Geometry.Polyline[m_polygon_graph.Length];

    //m_ff = new Vector3d[cTruss.Nodes.Length];
  }

  private void Stop(){
    // happens when everything is ends
    Print("Stopped");
  }

  private void Reset(){

  }

  private void Run(int UpdateCount, bool ShowDiagonals, bool ShowHelpers){
    // each step

    internal_free_force = cTruss.Update(UpdateCount);

    cTruss.Receive();
    m_nodes = cTruss.oNodes;
    m_rforces = cTruss.oReactionForces;
    //Nodes = cTruss.oNodes;
    //ReactionForces = cTruss.oReactionForces;

    for(int i = 0; i < m_beamCount; i++){
      m_beams[i] = new Line(
        cTruss.oNodes[cTruss.oBeamForces[i].Item1],
        cTruss.oNodes[cTruss.oBeamForces[i].Item2]);
      m_bforces[i] = cTruss.oBeamForces[i].Item3;
    }
    if(ShowDiagonals){

      for(int i = m_beamCount; i < m_diagonalsEndPointer; i++){
        m_diagonals[i - m_beamCount] = new Line(
          cTruss.oNodes[cTruss.oBeamForces[i].Item1],
          cTruss.oNodes[cTruss.oBeamForces[i].Item2]);
        m_bforces[i] = cTruss.oBeamForces[i].Item3;
      }
    }
    if(ShowHelpers){
      for(int i = m_diagonalsEndPointer; i < cTruss.ProtoBeams.Count; i++){

        m_helpers[i - m_diagonalsEndPointer] = new Line(
          cTruss.oNodes[cTruss.oBeamForces[i].Item1],
          cTruss.oNodes[cTruss.oBeamForces[i].Item2]);
        m_bforces[i] = cTruss.oBeamForces[i].Item3;
      }
    }

    for(int i = 0; i < m_polygon_graph.Length; i++){
      var temp = new List<Point3d>();
      foreach(int s in m_polygon_graph[i]){
        temp.Add(m_nodes[s]);
      }
      temp.Add(m_nodes[m_polygon_graph[i][0]]);
      //PolylineCurve polylineCurve = new Polyline(temp).ToPolylineCurve();
      //m_polygons[i] = Brep.CreatePatch(new List<GeometryBase> { polylineCurve }, 3, 3, 0.1);
      m_polygons[i] = new Polyline(temp);
    }





    //T++;
    //if (T == 500)IsRunning = false;

  }
# ---------- end run_2 ----------
helper_lines = Line(run_2.Helpers)
diagonals_2 = Line(run_2.Diagonals)
polygons = Curve(run_2.Polygons)
edges = Line(run_2.Beams)

# ----
# Faces Presentation: Fragmented Patch
fragment_patch = FragmentPatch(Boundary=graft(polygons))  # disabled

# ----
# Faces Presentation: Patch
# Warning!: Be careful! Patch component is really slow and Computation intensive, NEVER ENABLE THIS COMPONENT WHEN THE SIMULATION IS RUNNING, it could easily crash the Rhino. Enable it only when you reached the final form, turned the simulator off and you want to bake it to Rhino.
patch = Patch(Curves=graft(polygons), Spans=20, Flexibility=1, Trim=True)  # disabled

# ----
# Faces Presentation: Only for 4-sided surfaces
explode = Explode(Curve=polygons, Recursive=True)  # -> Segments, Vertices
list_length = ListLength(List=explode.Segments)  # -> simplify(Length)
equality = Equality(FirstNumber=list_length, SecondNumber=4)  # -> Equality, Inequality
dispatch = Dispatch(List=simplify(explode.Vertices), DispatchPattern=equality.Equality)  # -> ListA, ListB
list_item = ListItem(List=dispatch.ListA, Index=0, Wrap=True)  # -> Item, Item1, Item2, Item3
_4point_surface = _4PointSurface(CornerA=list_item.Item, CornerB=list_item.Item1, CornerC=list_item.Item2, CornerD=list_item.Item3)  # -> flatten(Surface)

# ----
# Faces Presentation: With a hole in the middle
filled_surface = Slider(0.57, range=0..1)
polygon_center = PolygonCenter(Polyline=polygons)  # -> CenterV, CenterE, CenterA
scale = Scale(Geometry=polygons, Center=polygon_center.CenterV, Factor=expr("1-x", filled_surface))  # -> simplify(graft(Geometry)), Transform
ruled_surface = RuledSurface(CurveA=simplify(graft(polygons)), CurveB=scale.Geometry)  # -> flatten(Surface)
